# Grasshopper definition test2.gh (Grasshopper 1.0.7)
# plug-ins: BITS

# ----
# File - input ifcJson data
# Text- Frame definition
panel = Panel("""{
    "@context": {
      "@vocab": "http://bsi.org/ifc/4x3/",
      "@base": "http://myfile.org/ids/",
      "ref": "@id",
      "data": "@graph",
      "type": "@type",
      "globalId": "@id"
    },
    "@type": "IfcProject",
    "@explicit": true,
    "isDecomposedBy": {
      "@explicit": true,
      "relatedObjects": {
        "@explicit": true,
        "containsElements": {
          "@explicit": true,
          "relatedElements": {
            "@explicit": true,
            "isNestedBy": {
              "@explicit": true,
              "relatedObjects": {
                "@explicit": true
              }
            }
          }
        }
      }
    }
  }""")
file_path = FilePath("C:\Users\Nirvik Saha\source\repos\BITS\bin\data\devonData.json")
jsonld_framing_text = JsonLD_Framing_Text(InputIfcJsonLD=file_path, InputFrameDefinition=panel)  # -> OutputFramedData, Debug; disabled
panel_2 = Panel(jsonld_framing_text.OutputFramedData)

# ----
# Format JSON
panel_3 = Panel("{\"@context\": {\"@vocab\": \"http://bsi.org/ifc/4x3/\",\"@base\": \"http://myfile.org/ids/\",\"ref\": \"@id\",\"data\": \"@graph\",\"type\": \"@type\",\"globalId\": \"@id\"}}")
jsonformattingmain = JsonFormattingMain(InputJson=panel_3)  # disabled
panel_4 = Panel(jsonformattingmain)

# ----
# Expanded
# (Careful - will slow down)
file_path_2 = FilePath("C:\Users\Nirvik Saha\Documents\PostDoc\jsonLD\wall_door_data\data_framing\wall_door.json")
json_ld_expanded = JsonLDExpanded(PathToIfcJsonFile=file_path_2)  # disabled
panel_5 = Panel(json_ld_expanded)

panel_6 = Panel("""{
  "@context": {
    "@vocab": "http://bsi.org/ifc/4x3/",
    "@base": "http://myfile.org/ids/",
    "ref": "@id",
    "data": "@graph",
    "type": "@type",
    "globalId": "@id"
  }
}""")
file_path_3 = FilePath("C:\Users\Nirvik Saha\source\repos\BITS\bin\data\context.json")
# Flattened
file_path_4 = FilePath("C:\Users\Nirvik Saha\Documents\PostDoc\jsonLD\wall_door_data\data_framing\wall_door.json")
json_ld_flattened = JsonLDFlattened(PathToIfcJsonFile=file_path_4, ContextJsonViaPanel=panel_6)
panel_7 = Panel(json_ld_flattened)
jsonwritetofile = JsonWriteToFile(
    PathDirToFile="C:\Users\Nirvik Saha\Documents\PostDoc",
    NameOfTheFile="helloBits.json",
    InputJsonViaPanelText="{a:1,b:2,c:3,d:[1,2,3,4]}")  # disabled
panel_8 = Panel(jsonwritetofile)
panel_9 = Panel("""{
  "@context": {
    "@vocab": "http://bsi.org/ifc/4x3/",
    "@base": "http://myfile.org/ids/",
    "ref": "@id",
    "data": "@graph",
    "type": "@type",
    "globalId": "@id"
  }
}""")
# Compacted
file_path_5 = FilePath("C:\Users\Nirvik Saha\Documents\PostDoc\jsonLD\wall_door_data\data_framing\wall_door.json")
jsonld_compacted = JsonLDCompacted(PathToIfcJsonFile=file_path_5, ContextJsonViaPanel=panel_9)  # disabled
panel_10 = Panel(jsonld_compacted)
