# Grasshopper definition webApi.gh (Grasshopper 1.0.7)
# plug-ins: BITS

# set a file path to any *.ifc file (revit export)
# 
# right click on "file path" component and
# "Set File Path". This opens a file dialog.
file_path = FilePath("C:\Users\Nirvik Saha\source\repos\BITS\bin\data\wall_door.ifc")
sample_ifc_json = SampleIfcJson(InputURL="https://ifcpyserver.azurewebsites.net/get/test", StartProcess=Toggle(True))
sample_ifc_json_2 = SampleIfcJson(InputURL="https://ifcpyserver.azurewebsites.net/post/test", StartProcess=Toggle(True))
sample_ifc_json_3 = SampleIfcJson(InputURL="https://ifcpyserver.azurewebsites.net/get/data", StartProcess=Toggle(False))  # disabled
ifc_json_from_step = IfcJsonFromStep(InputIFCFile=file_path, InputURL="https://ifcpyserver.azurewebsites.net/post/data", StartProcess=Toggle(False))  # disabled
panel = Panel(sample_ifc_json)
panel_2 = Panel(sample_ifc_json_2)
panel_3 = Panel(sample_ifc_json_3)
panel_4 = Panel(ifc_json_from_step)
